# Dynamo graph Script for Export Schedule from Revit to Excel.dyn (Dynamo 2.16.2.5624)
# packages: Data-Shapes 2021.2.94, Crumple 2021.5.27, bimorphNodes 3.0.3

# group: EXPORT SCHEDULE FROM REVIT TO EXCEL
code_block = CodeBlock { "EXPORT SCHEDULE"; "EXPORT"; "CANCEL"; 900; 600; 200; }
code_block_2 = CodeBlock { "SCHEDULE"; true; }
schedulesbytype = Custom[© SchedulesByType]()  # package Crumple; Returns all schedules in the model, separated into key and non-key schedules.
name = Element.Name(element=schedulesbytype.schedules)
code_block_3 = CodeBlock { " Internal"; false; }
contains = String.Contains(string=name, searchFor=code_block_3.out0, ignoreCase=code_block_3.out1)
filterByBoolMask = List.FilterByBoolMask(list=schedulesbytype.schedules, mask=contains)
name_2 = Element.Name(element=filterByBoolMask.out)
dropdown_data = Custom[DropDown Data](InputName=code_block_2.out0, Keys=name_2, Values=filterByBoolMask.out, Sorted_optional=code_block_2.out1)  # package Data-Shapes; Create data for DropDown input in UI.MultiInputForm ++ . Check out www.data-shapes.net for more infos.
code_block_4 = CodeBlock { "FILE PATH"; "Select a file..."; }
filepath_data = Custom[FilePath Data](InputName=code_block_4.out0, ButtonText=code_block_4.out1)  # package Data-Shapes; Create filepath input for UI.MultipleInputForm ++ . Check out www.data-shapes.net for more infos !
code_block_5 = CodeBlock { "SHEET NAME"; "Sheet1"; false; }
textbox_data = Custom[TextBox Data](InputName=code_block_5.out0, DefaultText=code_block_5.out1, IsNumberEntry=code_block_5.out2)  # package Data-Shapes; Create Data for TextBox input in UI.MultipleInputForm ++ . Check out www.data-shapes.net for more informations
list_create = List.Create(item0=dropdown_data, item1=filepath_data, item2=textbox_data)
boolean = BoolSelector(true)
multipleinputform = Custom[MultipleInputForm ++](Description_optional=code_block.out0, ButtonText_optional=code_block.out1, Inputs=list_create, Toggle=boolean, CancelButtonText_optional=code_block.out2, MaxHeight_optional=code_block.out3, Width_optional=code_block.out4, LabelWidth_optional=code_block.out5)  # package Data-Shapes; Create a form with multiple inputs. see www.data-shapes.net for tutorials and infos!
code_block_6 = CodeBlock(out=multipleinputform.User_Inputs) { sched = out[0]; path  = out[1]; sheet = out[2]; }
code_block_7 = CodeBlock { 0; true; }
code_block_8 = CodeBlock { false; }
getData = Revit.Schedule.GetData(scheduleView=code_block_6.sched, refresh=code_block_8)
exportToExcel = Data.ExportToExcel(filePath=code_block_6.path, sheetName=code_block_6.sheet, startRow=code_block_7.out0, startColumn=code_block_7.out0, data=getData, overWrite=code_block_7.out1)
watch = Watch(exportToExcel)
