# Dynamo graph Script for Gherkins Structure.dyn (Dynamo 2.16.2.5624)
# packages: LunchBox for Dynamo 2016.11.11, Clockwork for Dynamo 1.x 1.31.1, archi-lab.net 2018.0.8

# group: OUTER STRUCTURE OF GHERKIN > Profile 1
number = DoubleInput(0)
number_slider = DoubleSlider(176, range=0..176 step 1)
byCoordinates = Point.ByCoordinates(x=number, y=number, z=number_slider)
number_slider_2 = DoubleSlider(3, range=0..100 step 1)
byCenterPointRadius = Circle.ByCenterPointRadius(centerPoint=byCoordinates, radius=number_slider_2)

# group: OUTER STRUCTURE OF GHERKIN > Profile 2
number_2 = DoubleInput(0)
number_slider_3 = DoubleSlider(173, range=0..173 step 1)
byCoordinates_2 = Point.ByCoordinates(x=number_2, y=number_2, z=number_slider_3)
number_slider_4 = DoubleSlider(7, range=0..100 step 1)
byCenterPointRadius_2 = Circle.ByCenterPointRadius(centerPoint=byCoordinates_2, radius=number_slider_4)

# group: OUTER STRUCTURE OF GHERKIN > Profile 3
number_3 = DoubleInput(0)
number_slider_5 = DoubleSlider(168, range=0..168 step 1)
byCoordinates_3 = Point.ByCoordinates(x=number_3, y=number_3, z=number_slider_5)
number_slider_6 = DoubleSlider(11, range=0..100 step 1)
byCenterPointRadius_3 = Circle.ByCenterPointRadius(centerPoint=byCoordinates_3, radius=number_slider_6)

# group: OUTER STRUCTURE OF GHERKIN > Profile 4
number_4 = DoubleInput(0)
number_slider_7 = DoubleSlider(85, range=0..100 step 1)
byCoordinates_4 = Point.ByCoordinates(x=number_4, y=number_4, z=number_slider_7)
number_slider_8 = DoubleSlider(29, range=0..100 step 1)
byCenterPointRadius_4 = Circle.ByCenterPointRadius(centerPoint=byCoordinates_4, radius=number_slider_8)

# group: OUTER STRUCTURE OF GHERKIN > Profile 5
number_5 = DoubleInput(0)
number_slider_9 = DoubleSlider(0, range=0..100 step 1)
byCoordinates_5 = Point.ByCoordinates(x=number_5, y=number_5, z=number_slider_9)
number_slider_10 = DoubleSlider(25, range=0..100 step 1)
byCenterPointRadius_5 = Circle.ByCenterPointRadius(centerPoint=byCoordinates_5, radius=number_slider_10)

# group: OUTER STRUCTURE OF GHERKIN
list_create = List.Create(item0=byCenterPointRadius, item1=byCenterPointRadius_2, item2=byCenterPointRadius_3, item3=byCenterPointRadius_4, item4=byCenterPointRadius_5)
byLoft = Surface.ByLoft(crossSections=list_create)
code_block = CodeBlock { 22; 18; }
panelDiamond = Geometry.Panel.PanelDiamond(srf=byLoft, u=code_block.out0, v=code_block.out1)
family_types = FamilyTypes("Gherkin_Glazing:Tinted")
byPoints = AdaptiveComponent.ByPoints(points=panelDiamond.QuadPoints, familyType=family_types)

# group: INNER FLOOR HIGHER LEVELS
code_block_2 = CodeBlock { 89..161..4; }
byCoordinates_6 = Point.ByCoordinates(z=code_block_2)
byOriginNormal = Plane.ByOriginNormal(origin=byCoordinates_6)
code_block_3 = CodeBlock { 20; 20; }
byWidthLength = Rectangle.ByWidthLength(plane=byOriginNormal, width=code_block_3.out0, length=code_block_3.out1)
floor_types = FloorTypes("Standard Timber-Wood Finish")
byElevation = Level.ByElevation(elevation=code_block_2)
byOutlineTypeAndLevel = Floor.ByOutlineTypeAndLevel(outlineCurves=byWidthLength@L1, floorType=floor_types, level=byElevation)

# group: INNER FLOOR LOWER LEVELS
code_block_4 = CodeBlock { 1..85..4; }
byCoordinates_7 = Point.ByCoordinates(z=code_block_4)
byOriginNormal_2 = Plane.ByOriginNormal(origin=byCoordinates_7)
code_block_5 = CodeBlock { 25; 25; }
byWidthLength_2 = Rectangle.ByWidthLength(plane=byOriginNormal_2, width=code_block_5.out0, length=code_block_5.out1)
floor_types_2 = FloorTypes("Insitu Concrete 225mm")
byElevation_2 = Level.ByElevation(elevation=code_block_4)
byOutlineTypeAndLevel_2 = Floor.ByOutlineTypeAndLevel(outlineCurves=byWidthLength_2@L1, floorType=floor_types_2, level=byElevation_2)

# group: COLUMN AT LOWER LEVELS
code_block_6 = CodeBlock { -13; 13; 0; }
byCoordinates_8 = Point.ByCoordinates(x=code_block_6.out0, y=code_block_6.out1, z=code_block_6.out2)
code_block_7 = CodeBlock { 11; 13; 0; }
byCoordinates_9 = Point.ByCoordinates(x=code_block_7.out0, y=code_block_7.out1, z=code_block_7.out2)
byStartPointEndPoint = Line.ByStartPointEndPoint(startPoint=byCoordinates_8, endPoint=byCoordinates_9, lacing=CrossProduct)
code_block_8 = CodeBlock { 11; -11; 0; }
byCoordinates_10 = Point.ByCoordinates(x=code_block_8.out0, y=code_block_8.out1, z=code_block_8.out2)
byStartPointEndPoint_2 = Line.ByStartPointEndPoint(startPoint=byCoordinates_8, endPoint=byCoordinates_10, lacing=CrossProduct)
code_block_9 = CodeBlock { -13; -11; 0; }
byCoordinates_11 = Point.ByCoordinates(x=code_block_9.out0, y=code_block_9.out1, z=code_block_9.out2)
byStartPointEndPoint_3 = Line.ByStartPointEndPoint(startPoint=byCoordinates_8, endPoint=byCoordinates_11, lacing=CrossProduct)
intersect = Geometry.Intersect(geometry=byStartPointEndPoint_2, other=byStartPointEndPoint_3)
code_block_10 = CodeBlock { 85; }
translate = Geometry.Translate(geometry=intersect, zTranslation=code_block_10)
byStartPointEndPoint_4 = Line.ByStartPointEndPoint(startPoint=intersect, endPoint=translate)
levels = Levels("Level 23")
structural_column_types = StructuralColumnTypes("600 x 750mm")
columnByCurve = StructuralFraming.ColumnByCurve(curve=byStartPointEndPoint_4, level=levels, structuralColumnType=structural_column_types)
byStartPointEndPoint_5 = Line.ByStartPointEndPoint(startPoint=byCoordinates_10, endPoint=byCoordinates_11, lacing=CrossProduct)
intersect_2 = Geometry.Intersect(geometry=byStartPointEndPoint_3, other=byStartPointEndPoint_5)
code_block_11 = CodeBlock { 85; }
translate_2 = Geometry.Translate(geometry=intersect_2, zTranslation=code_block_11)
byStartPointEndPoint_6 = Line.ByStartPointEndPoint(startPoint=intersect_2, endPoint=translate_2)
columnByCurve_2 = StructuralFraming.ColumnByCurve(curve=byStartPointEndPoint_6, level=levels, structuralColumnType=structural_column_types)
byStartPointEndPoint_7 = Line.ByStartPointEndPoint(startPoint=byCoordinates_10, endPoint=byCoordinates_9, lacing=CrossProduct)
intersect_3 = Geometry.Intersect(geometry=byStartPointEndPoint_5, other=byStartPointEndPoint_7)
code_block_12 = CodeBlock { 85; }
translate_3 = Geometry.Translate(geometry=intersect_3, zTranslation=code_block_12)
byStartPointEndPoint_8 = Line.ByStartPointEndPoint(startPoint=intersect_3, endPoint=translate_3)
columnByCurve_3 = StructuralFraming.ColumnByCurve(curve=byStartPointEndPoint_8, level=levels, structuralColumnType=structural_column_types)
byStartPointEndPoint_9 = Line.ByStartPointEndPoint(startPoint=byCoordinates_9, endPoint=byCoordinates_11)
intersect_4 = Geometry.Intersect(geometry=byStartPointEndPoint_9, other=byStartPointEndPoint_7)
code_block_13 = CodeBlock { 85; }
translate_4 = Geometry.Translate(geometry=intersect_4, zTranslation=code_block_13)
byStartPointEndPoint_10 = Line.ByStartPointEndPoint(startPoint=intersect_4, endPoint=translate_4)
columnByCurve_4 = StructuralFraming.ColumnByCurve(curve=byStartPointEndPoint_10, level=levels, structuralColumnType=structural_column_types)

# group: COLUMN AT HIGHER LEVELS
code_block_14 = CodeBlock { -13; 13; 0; }
byCoordinates_12 = Point.ByCoordinates(x=code_block_14.out0, y=code_block_14.out1, z=code_block_14.out2)
code_block_15 = CodeBlock { 11; -11; 0; }
byCoordinates_13 = Point.ByCoordinates(x=code_block_15.out0, y=code_block_15.out1, z=code_block_15.out2)
byStartPointEndPoint_11 = Line.ByStartPointEndPoint(startPoint=byCoordinates_12, endPoint=byCoordinates_13, lacing=CrossProduct)
code_block_16 = CodeBlock { -13; -11; 0; }
byCoordinates_14 = Point.ByCoordinates(x=code_block_16.out0, y=code_block_16.out1, z=code_block_16.out2)
byStartPointEndPoint_12 = Line.ByStartPointEndPoint(startPoint=byCoordinates_12, endPoint=byCoordinates_14, lacing=CrossProduct)
intersect_5 = Geometry.Intersect(geometry=byStartPointEndPoint_11, other=byStartPointEndPoint_12)
code_block_17 = CodeBlock { 155; }
translate_5 = Geometry.Translate(geometry=intersect_5, zTranslation=code_block_17)
byStartPointEndPoint_13 = Line.ByStartPointEndPoint(startPoint=intersect_5, endPoint=translate_5)
levels_2 = Levels("Level 23")
structural_column_types_2 = StructuralColumnTypes("450 x 600mm")
columnByCurve_5 = StructuralFraming.ColumnByCurve(curve=byStartPointEndPoint_13, level=levels_2, structuralColumnType=structural_column_types_2)
byStartPointEndPoint_14 = Line.ByStartPointEndPoint(startPoint=byCoordinates_13, endPoint=byCoordinates_14, lacing=CrossProduct)
intersect_6 = Geometry.Intersect(geometry=byStartPointEndPoint_12, other=byStartPointEndPoint_14)
code_block_18 = CodeBlock { 155; }
translate_6 = Geometry.Translate(geometry=intersect_6, zTranslation=code_block_18)
byStartPointEndPoint_15 = Line.ByStartPointEndPoint(startPoint=intersect_6, endPoint=translate_6)
columnByCurve_6 = StructuralFraming.ColumnByCurve(curve=byStartPointEndPoint_15, level=levels_2, structuralColumnType=structural_column_types_2)
code_block_19 = CodeBlock { 11; 13; 0; }
byCoordinates_15 = Point.ByCoordinates(x=code_block_19.out0, y=code_block_19.out1, z=code_block_19.out2)
byStartPointEndPoint_16 = Line.ByStartPointEndPoint(startPoint=byCoordinates_13, endPoint=byCoordinates_15, lacing=CrossProduct)
intersect_7 = Geometry.Intersect(geometry=byStartPointEndPoint_14, other=byStartPointEndPoint_16)
code_block_20 = CodeBlock { 155; }
translate_7 = Geometry.Translate(geometry=intersect_7, zTranslation=code_block_20)
byStartPointEndPoint_17 = Line.ByStartPointEndPoint(startPoint=intersect_7, endPoint=translate_7)
columnByCurve_7 = StructuralFraming.ColumnByCurve(curve=byStartPointEndPoint_17, level=levels_2, structuralColumnType=structural_column_types_2)
byStartPointEndPoint_18 = Line.ByStartPointEndPoint(startPoint=byCoordinates_12, endPoint=byCoordinates_15, lacing=CrossProduct)
byStartPointEndPoint_19 = Line.ByStartPointEndPoint(startPoint=byCoordinates_15, endPoint=byCoordinates_14)
intersect_8 = Geometry.Intersect(geometry=byStartPointEndPoint_19, other=byStartPointEndPoint_16)
code_block_21 = CodeBlock { 155; }
translate_8 = Geometry.Translate(geometry=intersect_8, zTranslation=code_block_21)
byStartPointEndPoint_20 = Line.ByStartPointEndPoint(startPoint=intersect_8, endPoint=translate_8)
columnByCurve_8 = StructuralFraming.ColumnByCurve(curve=byStartPointEndPoint_20, level=levels_2, structuralColumnType=structural_column_types_2)

categories = Categories("OST_StructuralFoundation")
all_elements_of_category = ElementsOfCategory(Category=categories)

# group: Material
watch = Watch(all_elements_of_category)
materials = Custom[Element.Materials+](element=all_elements_of_category)  # package Clockwork for Dynamo 1.x; Retrieves all materials froma given element
watch_2 = Watch(materials.materials)
name = Material.Name(material=watch_2)
watch_3 = Watch(name)
watch_4 = Watch(materials.materialVolumes)

flatten = List.Flatten(list=watch_2)
name_2 = Material.Name(material=flatten)
watch_5 = Watch(name_2)
id = Element.Id(element=flatten)
sortListByAnother = archilab.Lists.Lists.SortListByAnother(list=watch_5, sortBy=id)
watch_6 = Watch(sortListByAnother.list)
countOccurences = Custom[List.CountOccurences](seq=watch_6)  # package Clockwork for Dynamo 1.x; Counts the number of occurences of each unique element in a given list
watch_7 = Watch(countOccurences.uniqueElements)
