# Dynamo graph Script for Shared parameters.dyn (Dynamo 2.16.2.5624)
# packages: Clockwork for Dynamo 1.x 1.31.1, archi-lab.net 2018.0.8

categories = Categories("OST_StructuralFoundation")
all_elements_of_category = ElementsOfCategory(Category=categories)

# group: Material
watch = Watch(all_elements_of_category)
materials = Custom[Element.Materials+](element=all_elements_of_category)  # package Clockwork for Dynamo 1.x; Retrieves all materials froma given element
watch_2 = Watch(materials.materials)
name = Material.Name(material=watch_2)
watch_3 = Watch(name)
watch_4 = Watch(materials.materialVolumes)

flatten = List.Flatten(list=watch_2)
name_2 = Material.Name(material=flatten)
watch_5 = Watch(name_2)
id = Element.Id(element=flatten)
sortListByAnother = archilab.Lists.Lists.SortListByAnother(list=watch_5, sortBy=id)
watch_6 = Watch(sortListByAnother.list)
countOccurences = Custom[List.CountOccurences](seq=watch_6)  # package Clockwork for Dynamo 1.x; Counts the number of occurences of each unique element in a given list
watch_7 = Watch(countOccurences.uniqueElements)

# group: CREATION OF SHARED PARAMETERS
code_block = CodeBlock { "PG_TEXT"; false; }
createSharedParameter = Parameter.CreateSharedParameter(groupType=code_block.out0, instance=code_block.out1)  # unwired: parameterName, groupName, specType, categoryList
file_path = Filename("..\..\PMAN7010\SHARED PARAMETERS FOR GHERKINS.ods")
file_from_path = FileObject(path=file_path)
code_block_2 = CodeBlock { "Sheet1"; True; false; }  # unwired: True
importExcel = Data.ImportExcel(file=file_from_path, sheetName=code_block_2.out0, readAsStrings=code_block_2.True, showExcel=code_block_2.out2)
restOfItems = List.RestOfItems(list=importExcel)
transpose = List.Transpose(lists=restOfItems)
code_block_3 = CodeBlock(lst=transpose) { pnames = lst[0]; groups = lst[1]; ptypes = lst[2]; }
combine = List.Combine(combineFunction=createSharedParameter, list0=code_block_3.pnames, list1=code_block_3.groups, list2=code_block_3.ptypes)
